# Grasshopper definition 10 Dome experiment.ghx (Grasshopper 1.0.8)
# plug-ins: Kangaroo2 Components

pt = Point(<point referenced from the Rhino model>)
number_slider = Slider(4216, range=3000..5000)
number_slider_2 = Slider(10, range=5..20)
number_slider_3 = Slider(10, range=5..20)
xy = XYPlane(Origin=pt)
sph = Sphere(Base=xy, Radius=number_slider)
cir = Circle(Plane=xy, Radius=number_slider)
msphere = MeshSphere(Base=xy, Radius=number_slider, UCount=number_slider_2, VCount=number_slider_3)
srfsplit = SurfaceSplit(Surface=sph, Curves=cir)
number_slider_4 = Slider(50, range=50..100)
medges = MeshEdges(Mesh=msphere)  # -> NakedEdges, InteriorEdges, NonManifoldEdges
item = ListItem(List=srfsplit, Index="0", Wrap=True)
pipe = Pipe(Curve=medges.InteriorEdges, Radius=number_slider_4, Caps=0)
addition = Addition(A=number_slider, B=number_slider_4)
qrmesh = QuadRemesh(Mesh=item, Settings={aqc=True, as=50, dhe=True, gci=0, null=False, pme=0, sa=0, tqc=2000})
msphere_2 = MeshSphere(Base=xy, Radius=addition, UCount=number_slider_2, VCount=number_slider_3)
faceb = FaceBoundaries(Mesh=msphere_2)
demesh = DeconstructMesh(Mesh=msphere_2)  # -> Vertices, Faces, Colours, Normals
facen = FaceNormals()  # -> Centers, Normals
unroller = Unroller(Strip=msphere_2, Unroll=1)
panel = Panel(demesh.Faces)
item_2 = ListItem(List=demesh.Faces, Index="0", Wrap=True)
